# Dynamo graph IFC_Coord-Calc and changing IFC.dyn (Dynamo 2.8.0.2015)

file_path = Filename(".\Renga-Demo.ifc")
string = StringInput("C:\Users\GeorgKeneberg\Documents\Temp\temp8.ifc")
import_coordinates_of_points_x_y = CodeBlock()  # "Import coordinates of points (X,Y,Z)"
# ---------- import_coordinates_of_points_x_y.designscript (6 lines) ----------
"33.297,-7.343,-0.400";
"-8.192,2.370,-0.400";
"3.793,7.651,-0.400";
"2216240.350,530158.768,142";
"2216208.042,530186.545,142";
"2216221.119,530185.692,142";
# ----------------------------------------
createDataMassive = IFC_Coord.General.CreateDataMassive(CurrentCS_Point1=import_coordinates_of_points_x_y.out0, CurrentCS_Point2=import_coordinates_of_points_x_y.out1, CurrentCS_Point3=import_coordinates_of_points_x_y.out2, FinishCS_Point1=import_coordinates_of_points_x_y.out3, FinishCS_Point2=import_coordinates_of_points_x_y.out4, FinishCS_Point3=import_coordinates_of_points_x_y.out5)
findParameters = IFC_Coord.Calculates.FindParameters(Data=createDataMassive)
renga_44 = IFC_Coord.IFC_4.Renga_44(PathToInputIFC=file_path, PathToSaveIFC=string, ΔX=findParameters.Смещение_по_оси_X_м, ΔY=findParameters.Смещение_по_оси_Y_м, ΔZ=findParameters.Смещение_по_оси_Z_м, ωz=findParameters.Угол_поворота_радианы)
