# Dynamo graph IFC_Coord-Calculate parameters for Navis and save.dyn (Dynamo 2.8.0.2015)
# packages: ModelsCoordination 1.0.0

# group: User's input parameters
import_coordinates_of_points_x_y = CodeBlock()  # "Import coordinates of points (X,Y,Z)"
# ---------- import_coordinates_of_points_x_y.designscript (6 lines) ----------
"33.297,-7.343,-0.400";
"-8.192,2.370,-0.400";
"3.793,7.651,-0.400";
"2216240.350,530158.768,142";
"2216208.042,530186.545,142";
"2216221.119,530185.692,142";
# ----------------------------------------
createDataMassive = IFC_Coord.General.CreateDataMassive(CurrentCS_Point1=import_coordinates_of_points_x_y.out0, CurrentCS_Point2=import_coordinates_of_points_x_y.out1, CurrentCS_Point3=import_coordinates_of_points_x_y.out2, FinishCS_Point1=import_coordinates_of_points_x_y.out3, FinishCS_Point2=import_coordinates_of_points_x_y.out4, FinishCS_Point3=import_coordinates_of_points_x_y.out5)

# group: Calculating parameters
findParameters = IFC_Coord.Calculates.FindParameters(Data=createDataMassive)

code_block = CodeBlock { -1; }
mul = findParameters.Rotation_angle_grades * code_block

# group: Result parameters - write to Navisworks
x_offset_meters = Watch(findParameters.Offset_of_X_axis_meters)
y_offset_meters = Watch(findParameters.Offset_of_Y_axis_meters)
z_offset_meters = Watch(findParameters.Offset_of_Z_axis_meters)
rotation_angle_grades = Watch(mul)

# group: Saving results to external XML-file (need a specific path)
string = StringInput("C:\results.xml")
saveResultsOfCalculating = IFC_Coord.Calculates.SaveResultsOfCalculating(ΔX=findParameters.Offset_of_X_axis_meters, ΔY=findParameters.Offset_of_Y_axis_meters, ΔZ=findParameters.Offset_of_Z_axis_meters, ωz=findParameters.Rotation_angle_radians, error=findParameters.Linear_error_meters, SaveFilePath=string)
