# Dynamo graph IFC_Coord-Load saved parameters for Navis.dyn (Dynamo 2.8.0.2015)

file_path = Filename("..\..\..\..\results.xml")
loadResultsOfCalculating = IFC_Coord.Calculates.LoadResultsOfCalculating(PathToFile=file_path)
code_block = CodeBlock { -1; }
mul = loadResultsOfCalculating.Rotation_angle_grades * code_block

# group: Result parameters - write to Navisworks
x_offset_meters = Watch(loadResultsOfCalculating.Offset_of_X_axis_meters)
y_offset_meters = Watch(loadResultsOfCalculating.Offset_of_Y_axis_meters)
z_offset_meters = Watch(loadResultsOfCalculating.Offset_of_Z_axis_meters)
rotation_angle_grades = Watch(mul)
