# Dynamo graph IFC_Coord-Load xml and changing IFC.dyn (Dynamo 2.8.0.2015)

file_path = Filename("..\..\..\..\Users\GeorgKeneberg\Documents\Temp\temp1.xml")
loadResultsOfCalculating = IFC_Coord.Calculates.LoadResultsOfCalculating(PathToFile=file_path)
file_path_2 = Filename("C:\Work\Code\IFC_GeoSupport\Dynamo_Samples\Renga-Demo.ifc")
string = StringInput("C:\Users\GeorgKeneberg\Documents\Temp\temp2.ifc")
renga_44 = IFC_Coord.IFC_4.Renga_44(PathToInputIFC=file_path_2, PathToSaveIFC=string)  # unwired: ΔX, ΔY, ΔZ, ωz
